# Dynamo graph RELATORIO DE CLASH EM HTML - R02_script.dyn (Dynamo 2.13.1.3887)
# IMPORTAR RELATÓRIO DE CLASH (HTML)
# packages: Data-Shapes 2024.2.114

python_script = Python()  # IronPython2; unwired: IN[0]
# ---------- python_script.python (19 lines) ----------
import clr
clr.AddReference('System.Windows.Forms')
from System.Windows.Forms import OpenFileDialog, DialogResult

# Função para abrir a janela de seleção de arquivo
def select_file():
    dialog = OpenFileDialog()
    dialog.Filter = "All files (*.*)|*.*"  # Define o filtro para todos os arquivos
    result = dialog.ShowDialog()  # Mostra o diálogo
    if result == DialogResult.OK:  # Verifica se o usuário clicou "OK"
        return dialog.FileName  # Retorna o caminho do arquivo
    else:
        return None  # Se cancelar, retorna None

# Chama a função de seleção de arquivo
file_selected = select_file()

# Saída do caminho do arquivo ou None se cancelado
OUT = file_selected
# ----------------------------------------

# group: IMPORTAR EXCEL
file_from_path = FileObject(path=python_script)
worksheets = Custom[Excel.Worksheets](FilePath=python_script)  # package Data-Shapes; Gets worksheet names from specified Excel workbook.
boolean = BoolSelector(false)
importExcel = Data.ImportExcel(file=file_from_path, sheetName=worksheets, showExcel=boolean)
flatten = List.Flatten(list=importExcel)

# group: REDUZIR LISTA
string_from_object = FromObject(object=flatten)
string = StringInput("Image")
contains = String.Contains(string=string_from_object, searchFor=string)
filterByBoolMask = List.FilterByBoolMask(list=string_from_object, mask=contains)
indexOf = List.IndexOf(list=flatten, element=filterByBoolMask.in)
code_block = CodeBlock { 1; }
sub = indexOf - code_block
code_block_2 = CodeBlock(n=sub) { n; 0..n; }
string_2 = StringInput("Comments")
code_block_3 = CodeBlock { 1; }

# group (continued): IMPORTAR EXCEL
removeItemAtIndex = List.RemoveItemAtIndex(list=flatten, indices=code_block_2.out1)
flatten_2 = List.Flatten(list=removeItemAtIndex)

# group (continued): REDUZIR LISTA
string_from_object_2 = FromObject(object=removeItemAtIndex)
contains_2 = String.Contains(string=string_from_object_2, searchFor=string_2)
filterByBoolMask_2 = List.FilterByBoolMask(list=string_from_object_2, mask=contains_2)
indexOf_2 = List.IndexOf(list=removeItemAtIndex, element=filterByBoolMask_2.in, lacing=Longest)
add = indexOf_2 + code_block_3
count = List.Count(list=removeItemAtIndex, lacing=Longest)
code_block_4 = CodeBlock(n=add, m=count) { n; m; n..m; }

# group (continued): IMPORTAR EXCEL
removeItemAtIndex_2 = List.RemoveItemAtIndex(list=flatten_2, indices=code_block_4.out2)

# group: ELEMENT ID
list_create = List.Create(item0=importExcel)
flatten_3 = List.Flatten(list=removeItemAtIndex_2)
string_from_object_3 = FromObject(object=flatten_3)
string_3 = StringInput("Element Id")
contains_3 = String.Contains(string=string_from_object_3, searchFor=string_3)
filterByBoolMask_3 = List.FilterByBoolMask(list=flatten_3, mask=contains_3)
indexOf_3 = List.IndexOf(list=flatten_3, element=filterByBoolMask_3.in)
firstItem = List.FirstItem(list=indexOf_3)
getItemAtIndex = List.GetItemAtIndex(list=list_create@L2, index=firstItem)
code_block_5 = CodeBlock { 0..7; }
removeItemAtIndex_3 = List.RemoveItemAtIndex(list=getItemAtIndex, indices=code_block_5)
string_from_object_4 = FromObject(object=removeItemAtIndex_3)
code_block_6 = CodeBlock { 7; }
code_block_7 = CodeBlock { 7; }
remove = String.Remove(string=string_from_object_4, startIndex=code_block_6, count=code_block_7)
toNumber = String.ToNumber(string=remove)
element_by_id = ElementById(Id=toNumber)
getItemAtIndex_2 = List.GetItemAtIndex(list=flatten_3, index=firstItem)

boolean_2 = BoolSelector(false)
clean = List.Clean(list=element_by_id, preserveIndices=boolean_2)
indexOf_4 = List.IndexOf(list=clean, element=element_by_id)
code_block_8 = CodeBlock { -1; }
eq = indexOf_4 == code_block_8
filterByBoolMask_4 = List.FilterByBoolMask(list=element_by_id, mask=eq)

# group: CLASH NAME
flatten_4 = List.Flatten(list=removeItemAtIndex_2)
string_from_object_5 = FromObject(object=flatten_4)
string_4 = StringInput("Clash Name")
contains_4 = String.Contains(string=string_from_object_5, searchFor=string_4)
filterByBoolMask_5 = List.FilterByBoolMask(list=flatten_4, mask=contains_4)
indexOf_5 = List.IndexOf(list=flatten_4, element=filterByBoolMask_5.in)
getItemAtIndex_3 = List.GetItemAtIndex(list=flatten_4, index=indexOf_5)
list_create_2 = List.Create(item0=importExcel)
getItemAtIndex_4 = List.GetItemAtIndex(list=list_create_2@L2, index=indexOf_5)
code_block_9 = CodeBlock { 0..7; }
removeItemAtIndex_4 = List.RemoveItemAtIndex(list=getItemAtIndex_4, indices=code_block_9)

filterByBoolMask_6 = List.FilterByBoolMask(list=removeItemAtIndex_4, mask=eq)

# group: PREENCHE PARAMETRO CLASH NAME
setParameterByName = Element.SetParameterByName(element=filterByBoolMask_4.out, parameterName=[getItemAtIndex_3, getItemAtIndex_3], value=filterByBoolMask_6.out, lacing=Longest)

# group: STATUS
flatten_5 = List.Flatten(list=removeItemAtIndex_2)
string_from_object_6 = FromObject(object=flatten_5)
string_5 = StringInput("Status")
contains_5 = String.Contains(string=string_from_object_6, searchFor=string_5)
filterByBoolMask_7 = List.FilterByBoolMask(list=flatten_5, mask=contains_5)
indexOf_6 = List.IndexOf(list=flatten_5, element=filterByBoolMask_7.in)
getItemAtIndex_5 = List.GetItemAtIndex(list=flatten_5, index=indexOf_6)
list_create_3 = List.Create(item0=importExcel)
getItemAtIndex_6 = List.GetItemAtIndex(list=list_create_3@L2, index=indexOf_6)
code_block_10 = CodeBlock { 0..7; }
removeItemAtIndex_5 = List.RemoveItemAtIndex(list=getItemAtIndex_6, indices=code_block_10)
string_6 = StringInput("Active")

filterByBoolMask_8 = List.FilterByBoolMask(list=removeItemAtIndex_5, mask=eq)

# group: PREENCHE PARAMETRO STATUS
setParameterByName_2 = Element.SetParameterByName(element=filterByBoolMask_4.out, parameterName=getItemAtIndex_5, value=filterByBoolMask_8.out, lacing=Longest)

string_7 = StringInput("Item ID")
filterByBoolMask_9 = List.FilterByBoolMask(list=toNumber, mask=eq)
string_from_object_7 = FromObject(object=filterByBoolMask_9.out)

# group: PREENCHE PARAMETRO ELEMENT ID
setParameterByName_3 = Element.SetParameterByName(element=filterByBoolMask_4.out, parameterName=string_7, value=string_from_object_7, lacing=Longest)

string_8 = StringInput("Disciplina")
string_from_object_8 = FromObject(object=python_script)
string_9 = StringInput("\")
split = String.Split(string=string_from_object_8, separator0=string_9)
lastItem = List.LastItem(list=split)
setParameterByName_4 = Element.SetParameterByName(element=filterByBoolMask_4.out, parameterName=string_8, value=lastItem, lacing=Longest)

# group (continued): STATUS
ne = filterByBoolMask_8.out != string_6

# group: PREENCHE PARAMETRO RESOLVIDO
string_10 = StringInput("Resolvido")
setParameterByName_5 = Element.SetParameterByName(element=filterByBoolMask_4.out, parameterName=string_10, value=ne, lacing=Longest)

# group: SELEÇÃO DO ARQUIVO HTML
selecione_o_arquivo_que_deseja = Filename("Q:\PASSOS\LAZER\PRAÇA BARÚ DE PADUA\03- PROJETOS\DISCIPLINAS\COMPATIBILIZAÇÃO\NWC_NWF\CLASHES\RELATÓRIOS\ELE\ELE X ESTC-CPT-PAS282-PBPD-R0_23_09.html")  # "SELECIONE O ARQUIVO QUE DESEJA FAZER A COMPATIBILIZAÇÃO (html)."; frozen
string_11 = StringInput("Selecione o Relatório de Clash  (*.html)")
filepath_data = Custom[FilePath Data](DefaulPath=python_script, ButtonText=string_11)  # package Data-Shapes; Create filepath input for UI.MultipleInputForm ++ . Check out www.data-shapes.net for more infos !
list_create_4 = List.Create(item0=filepath_data)

# group: LOCALIZAR A DISCIPLINA
code_block_11 = CodeBlock { "ARQ"; "AVE"; "CAB"; "ESTC"; "ESTME"; "GLP"; "GSM"; "HID"; "INC"; "LMT"; "SDAI"; "SPDA"; "ELE"; }
list_create_5 = List.Create(item0=code_block_11.out0, item1=code_block_11.out1, item2=code_block_11.out2, item3=code_block_11.out3, item4=code_block_11.out4, item5=code_block_11.out5, item6=code_block_11.out6, item7=code_block_11.out7, item8=code_block_11.out8, item9=code_block_11.out9, item10=code_block_11.out10, item11=code_block_11.out11, item12=code_block_11.out12)
code_block_12 = CodeBlock { " x "; }
code_block_13 = CodeBlock(list0=list_create_5, list1=code_block_11.out0, list2=code_block_11.out1, list3=code_block_11.out2, list4=code_block_11.out3, list5=code_block_11.out4, list6=code_block_11.out5, list7=code_block_11.out6, list8=code_block_11.out7, list9=code_block_11.out8, list10=code_block_11.out9, list11=code_block_11.out10, list12=code_block_11.out11, list13=code_block_11.out12, x=code_block_12)
# ---------- code_block_13.designscript (28 lines) ----------
list0;
list1;
list2;
list3;
list4;
list5;
list6;
list7;
list8;
list9;
list10;
list11;
list12;
list13;
x;
ARQ = list1 + x + list0;
AVE = list2 + x + list0;
CAB = list3 + x + list0;
ESTC = list4 + x + list0;
ESTME = list5 + x + list0;
GLP = list6 + x + list0;
GSM = list7 + x + list0;
HID = list8 + x + list0;
INC = list9 + x + list0;
LMT = list10 + x + list0;
SDAI = list11 + x + list0;
SPDA = list12 + x + list0;
ELE = list13 + x + list0;
# ----------------------------------------
list_create_6 = List.Create(item0=code_block_13.ARQ, item1=code_block_13.AVE, item2=code_block_13.CAB, item3=code_block_13.ESTC, item4=code_block_13.ESTME, item5=code_block_13.GLP, item6=code_block_13.GSM, item7=code_block_13.HID, item8=code_block_13.INC, item9=code_block_13.LMT, item10=code_block_13.SDAI, item11=code_block_13.SPDA, item12=code_block_13.ELE)
flatten_6 = List.Flatten(list=list_create_6)
string_from_object_9 = FromObject(object=flatten_6)
contains_6 = String.Contains(string=worksheets, searchFor=string_from_object_9, lacing=Longest)
filterByBoolMask_10 = List.FilterByBoolMask(list=string_from_object_9, mask=contains_6)

file_path = Filename("\\servidor\PUBLICO\USUARIOS\HUDSON\LOGO.jpg")
string_12 = StringInput("ROTINA PARA IMPORTAR RELATORIO DE CLASH.")
file_from_path_2 = FileObject(path=list_create_4)
readFromFile = Image.ReadFromFile(file=file_from_path_2)
string_13 = StringInput("Confirmar")
boolean_3 = BoolSelector(true)
string_14 = StringInput("Cancelar")
number = DoubleInput(200)
multipleinputform = Custom[MultipleInputForm ++](Description_optional=string_12, Logo_optional=readFromFile, ButtonText_optional=string_13, Inputs=list_create_4, Toggle=boolean_3, CancelButtonText_optional=string_14, LabelWidth_optional=number)  # frozen; package Data-Shapes; Create a form with multiple inputs. see www.data-shapes.net for tutorials and infos!
code_block_14 = CodeBlock(IN=multipleinputform.User_Inputs) { texto = IN[0]; }
length = String.Length(string=worksheets)
file_path_2 = Filename("Q:\PASSOS\LAZER\PRAÇA BARÚ DE PADUA\03- PROJETOS\DISCIPLINAS\COMPATIBILIZAÇÃO\NWC_NWF\CLASHES\RELATÓRIOS\ELE\ELE X HID-CPT-PAS282-PBPD-R0_23_09.html")  # frozen

# group: CLASH NAME
flatten_7 = List.Flatten(list=removeItemAtIndex_2)
string_from_object_10 = FromObject(obj=flatten_7)
string_15 = StringInput("LOCALIZAÇÃO")
contains_7 = String.Contains(string=string_from_object_10, searchFor=string_15)
filterByBoolMask_11 = List.FilterByBoolMask(list=flatten_7, mask=contains_7)
indexOf_7 = List.IndexOf(list=flatten_7, element=filterByBoolMask_11.in)
list_create_7 = List.Create(item0=importExcel)
code_block_15 = CodeBlock { 0..7; }

firstItem_2 = List.FirstItem(list=indexOf_7)

# group (continued): CLASH NAME
getItemAtIndex_7 = List.GetItemAtIndex(list=flatten_7, index=firstItem_2)
getItemAtIndex_8 = List.GetItemAtIndex(list=list_create_7@L2, index=firstItem_2)
removeItemAtIndex_6 = List.RemoveItemAtIndex(list=getItemAtIndex_8, indices=code_block_15)

string_16 = StringInput("Comentário Clash")
filterByBoolMask_12 = List.FilterByBoolMask(list=removeItemAtIndex_6, mask=eq)

# group: PREENCHE PARAMETRO CLASH NAME
setParameterByName_6 = Element.SetParameterByName(element=filterByBoolMask_4.out, parameterName=string_16, value=filterByBoolMask_12.out, lacing=Longest)

file_path_3 = Filename("Nenhum arquivo selecionado.")  # frozen
file_path_4 = Filename("Nenhum arquivo selecionado.")  # frozen
file_from_path_3 = FileObject(path=file_path_4)
