# Dynamo graph TOMADAS EMERGENCIA 2 NIVEIS_script.dyn (Dynamo 2.13.1.3887)
# packages: Clockwork for Dynamo 2.x 2.4.0, Genius Loci 2024.2.26, bimorphNodes 5.1.3

n1_selecione_o_vinculo = DSModelElementSelection()  # "1. SELECIONE O VINCULO"; 1 picked in the model; graph input
family_types = FamilyTypes("1.a_1 Tomada 2P+T_Conjunto 4x2:a. Tomada 2P+T 10A")
python_script = Python()  # IronPython2; unwired: IN[0]
# ---------- python_script.python (65 lines) ----------
# Importando as bibliotecas do Revit e Windows Forms
import clr
clr.AddReference("RevitServices")
from RevitServices.Persistence import DocumentManager
from RevitServices.Transactions import TransactionManager

clr.AddReference("RevitAPI")
from Autodesk.Revit.DB import *

# Adicionando referência para System.Windows.Forms
clr.AddReference("System.Windows.Forms")
from System.Windows.Forms import MessageBox, MessageBoxButtons

# Obtendo o documento atual do Revit
doc = DocumentManager.Instance.CurrentDBDocument

# Função para obter a unidade de comprimento
def get_length_unit_format(doc):
    # Obtendo as unidades do documento
    units = doc.GetUnits()

    # Acessando as opções de formato para o comprimento
    format_options = units.GetFormatOptions(SpecTypeId.Length)

    # Obtendo o ID da unidade de comprimento atual
    unit_type_id = format_options.GetUnitTypeId()

    # Retornando a unidade de comprimento atual
    return unit_type_id

# Função para definir a unidade de comprimento para centímetros
def set_length_unit_to_centimeters(doc):
    # Iniciando uma transação para modificar as unidades
    TransactionManager.Instance.EnsureInTransaction(doc)

    # Obtendo as unidades atuais
    units = doc.GetUnits()

    # Criando novas opções de formato para definir como centímetros
    format_options = FormatOptions(UnitTypeId.Centimeters)

    # Definindo as opções para o comprimento (Length)
    units.SetFormatOptions(SpecTypeId.Length, format_options)

    # Aplicando as mudanças ao documento
    doc.SetUnits(units)

    # Finalizando a transação
    TransactionManager.Instance.TransactionTaskDone()

# Obtendo a unidade de comprimento atual
length_unit = get_length_unit_format(doc)

# Verificando se a unidade não é centímetros e mudando se necessário
if length_unit != UnitTypeId.Centimeters:
    set_length_unit_to_centimeters(doc)
    result = "Unidade de comprimento alterada para Centímetros"
else:
    result = "A unidade de comprimento já está em Centímetros"

# Exibir uma janela pop-up para o usuário confirmar a mensagem
MessageBox.Show(result, "Confirmação", MessageBoxButtons.OK)

# Retornar 1 para o Dynamo após o usuário clicar em OK
OUT = 1
# ----------------------------------------
python_script_2 = Python(IN[0]=python_script)  # IronPython2
# ---------- python_script_2.python (63 lines) ----------
#TEMPLATE Python Script by BIM Coder
#Versão 1.0 - 08/24

#---IMPORTAÇÕES
# Sistema e .NET
import clr
import System
from System import Array
from System.Collections.Generic import *

# Biblioteca de Geometria do Dynamo
clr.AddReference('ProtoGeometry')
from Autodesk.DesignScript.Geometry import *

# Nós do Dynamo
clr.AddReference('RevitNodes')
import Revit
clr.ImportExtensions(Revit.Elements)
clr.ImportExtensions(Revit.GeometryConversion)

# Documentos e Transações
clr.AddReference('RevitServices')
import RevitServices
from RevitServices.Persistence import DocumentManager
from RevitServices.Transactions import TransactionManager

# DB da API do Revit
import Autodesk
clr.AddReference('RevitAPI')
from Autodesk.Revit.DB import *

# Interface do usuário da API do Revit
clr.AddReference('RevitAPIUI')
from Autodesk.Revit.UI import *

from Autodesk.Revit.UI.Selection import ObjectType

# Documentos e Interfaces
doc = DocumentManager.Instance.CurrentDBDocument
uiapp = DocumentManager.Instance.CurrentUIApplication
app = uiapp.Application
uidoc = uiapp.ActiveUIDocument

#---ENTRADA 0: Verificar se a unidade foi alterada para centímetros
unit_check = IN[0]

# Verificando se a entrada 0 é igual a 1 (unidade foi alterada para centímetros)
if unit_check == 1:
    try:
        # Solicitar ao usuário que selecione um objeto do tipo Element (por exemplo, paredes, janelas, etc.)
        selected_reference = uidoc.Selection.PickObject(ObjectType.Element)
        # Obter o elemento a partir da referência
        selected_element = uidoc.Document.GetElement(selected_reference)

        # Saída para o Dynamo (elemento Revit selecionado)
        OUT = selected_element

    except Exception as e:
        # Se houver um erro (como se o usuário cancelar a seleção), retornar uma mensagem de erro
        OUT = str(e)
else:
    # Se a entrada 0 não for 1, exibir uma mensagem dizendo que a unidade não foi alterada
    OUT = "A unidade não foi alterada para centímetros, seleção de elemento não permitida."
# ----------------------------------------
n2_categoria_do_elemento_no = Categories("OST_LightingFixtures")  # "2. CATEGORIA DO ELEMENTO NO VINCULO"; graph input
ofCategory = Revit.LinkElement.OfCategory(linkInstance=python_script_2, category=n2_categoria_do_elemento_no)
element_level = Custom[Element Level](element=ofCategory)  # package Genius Loci; Gets an element's level. Based on a Clockwork's node
name = Level.Name(level=element_level)
n3_nível_da_luminária_de_incêndio = StringInput("")  # "3. NÍVEL DA LUMINÁRIA DE INCÊNDIO"; graph input
boolean = BoolSelector(true)
contains = String.Contains(string=name, searchFor=n3_nível_da_luminária_de_incêndio, ignoreCase=boolean, lacing=Longest)
filterByBoolMask = List.FilterByBoolMask(list=ofCategory, mask=contains)
getLocation = Element.GetLocation(element=filterByBoolMask.in)
handOrientation = Custom[FamilyInstance.HandOrientation](familyInstance=filterByBoolMask.in)  # package Clockwork for Dynamo 2.x; Gets the hand orientation of a hosted object (e.g. a window or a door)
code_block = CodeBlock { 17; }
translate = Geometry.Translate(geometry=getLocation, direction=handOrientation, distance=code_block)
python_script_3 = Python()  # IronPython2; unwired: IN[0]
# ---------- python_script_3.python (18 lines) ----------
# Importando bibliotecas necessárias
import clr

# Adicionando referências necessárias
clr.AddReference('RevitAPI')
clr.AddReference('RevitServices')
from RevitServices.Persistence import DocumentManager
from Autodesk.Revit.DB import FilteredElementCollector, Level

# Obtendo o documento ativo
doc = DocumentManager.Instance.CurrentDBDocument

# Coletando todos os níveis no documento
levels_collector = FilteredElementCollector(doc).OfClass(Level)
levels = levels_collector.ToElements()

# Saída: lista de objetos de nível
OUT = levels  # Isso agora armazena os objetos Level em vez de strings
# ----------------------------------------
code_block_2 = CodeBlock { 1; }
python_script_4 = Python()  # IronPython2; unwired: IN[0]
# ---------- python_script_4.python (21 lines) ----------
# Importando bibliotecas necessárias
import clr

# Adicionando referências necessárias
clr.AddReference('RevitAPI')
clr.AddReference('RevitServices')
from RevitServices.Persistence import DocumentManager
from Autodesk.Revit.DB import FilteredElementCollector, Level

# Obtendo o documento ativo
doc = DocumentManager.Instance.CurrentDBDocument

# Coletando todos os níveis no documento
levels_collector = FilteredElementCollector(doc).OfClass(Level)
levels = levels_collector.ToElements()

# Criando uma lista para armazenar os nomes dos níveis
level_names = [level.Name for level in levels]

# Saída: lista de nomes de níveis
OUT = level_names
# ----------------------------------------
count = List.Count(list=python_script_4)
range = Range(start=code_block_2, end=count, step=code_block_2)
code_block_3 = CodeBlock(range=range, nivel=python_script_4) { range + " - " + nivel; }
python_script_5 = Python(IN[0]=code_block_3)  # IronPython2
# ---------- python_script_5.python (101 lines) ----------
import clr
clr.AddReference('System.Windows.Forms')
clr.AddReference('System.Drawing')

from System.Windows.Forms import Application, Form, Label, TextBox, Button, MessageBox, FormStartPosition
from System.Drawing import Point, Size, Color

class LevelSelectionForm(Form):
    def __init__(self, levels, theme='Dark'):
        # Configurações do Formulário
        self.Text = "Selecione um Nível"
        self.Size = Size(290, 360)
        self.StartPosition = FormStartPosition.CenterScreen
        self.ShowIcon = False
        self.MaximizeBox = False
        self.MinimizeBox = False

        # Configuração do tema
        if theme == 'Light':
            self.BackColor = Color.White
            self.ForeColor = Color.Black
        else:
            self.BackColor = Color.FromArgb(45, 45, 48)  # Dark theme
            self.ForeColor = Color.White

        self.levels = levels
        self.create_form(levels)
        self.create_ok_cancel_buttons()

    def create_form(self, levels):
        """Cria a Label e a TextBox para o usuário inserir o nível desejado."""
        lbl = Label()
        lbl.Text = "Níveis disponíveis:\n\nDigite o número referente ao nível"
        lbl.Location = Point(20, 30)
        lbl.Size = Size(230, 50)
        self.Controls.Add(lbl)

        # Adiciona os níveis em uma label
        levels_text = "\n".join(levels)
        levels_label = Label()
        levels_label.Text = levels_text
        levels_label.Location = Point(20, 80)
        levels_label.Size = Size(200, 100)
        self.Controls.Add(levels_label)

        self.txt_input = TextBox()
        self.txt_input.Location = Point(20, 200)
        self.txt_input.Size = Size(230, 30)
        self.Controls.Add(self.txt_input)

    def create_ok_cancel_buttons(self):
        """Cria os botões OK e Cancelar para o formulário."""
        # Botão OK
        btn_ok = Button()
        btn_ok.Text = "OK"
        btn_ok.Location = Point(40, 280)
        btn_ok.Size = Size(90, 30)
        btn_ok.Click += self.on_ok
        self.Controls.Add(btn_ok)

        # Botão Cancelar
        btn_cancel = Button()
        btn_cancel.Text = "Cancelar"
        btn_cancel.Location = Point(160, 280)
        btn_cancel.Size = Size(90, 30)
        btn_cancel.Click += self.on_cancel
        self.Controls.Add(btn_cancel)

    def on_ok(self, sender, event):
        """Captura o número digitado, verifica e fecha o formulário."""
        user_input = self.txt_input.Text.strip()  # Obtém o texto do usuário
        self.user_selection = None  # Inicializa a seleção

        # Verifica se o input do usuário é um número válido
        if user_input.isdigit():
            user_input_number = int(user_input) - 1  # Ajusta para índice baseado em zero
            if 0 <= user_input_number < len(self.levels):
                self.user_selection = self.levels[user_input_number].split(" - ", 1)[-1]
            else:
                MessageBox.Show("Número fora do intervalo dos níveis disponíveis. Tente novamente.", "Erro", 0)
        else:
            MessageBox.Show("Por favor, digite um número válido.", "Erro", 0)

        if self.user_selection is not None:
            self.Close()

    def on_cancel(self, sender, event):
        """Fecha o formulário sem selecionar um nível."""
        self.user_selection = None
        self.Close()

# Exemplo de níveis passados como entrada (substitua por IN[0] no Dynamo)
levels = IN[0]  # Exemplo de nomes de níveis já numerados

# Criação do formulário
theme = "Dark"  # Você pode mudar para "Light" se quiser o tema claro
form = LevelSelectionForm(levels, theme)
Application.Run(form)

# O nível selecionado pelo usuário será armazenado na variável 'form.user_selection'
OUT = form.user_selection
# ----------------------------------------
name_2 = Level.Name(level=python_script_3)
eq = python_script_5 == name_2
filterByBoolMask_2 = List.FilterByBoolMask(list=python_script_3, mask=eq)
byPointAndLevel = FamilyInstance.ByPointAndLevel(familyType=family_types, point=translate, level=filterByBoolMask_2.in, lacing=Longest)
YAxis = Vector.YAxis()
reverse = Vector.Reverse(vector=YAxis)
ZAxis = Vector.ZAxis()
angleAboutAxis = Vector.AngleAboutAxis(vector=reverse, otherVector=handOrientation, rotationAxis=ZAxis)
code_block_4 = CodeBlock { 270; }
sub = angleAboutAxis - code_block_4
element_setrotation = Custom[Element SetRotation](element=byPointAndLevel, degree=sub)  # package Genius Loci; Set the angle of the element around its local Z-axis. (Same as the Rotate command in Revit)
code_block_5 = CodeBlock { "Potência Ativa (W)"; 20; }
setParameterByName = Element.SetParameterByName(element=byPointAndLevel, parameterName=code_block_5.out0, value=code_block_5.out1)
code_block_6 = CodeBlock { "Deslocamento do hospedeiro"; 0; }
setParameterByName_2 = Element.SetParameterByName(element=byPointAndLevel, parameterName=code_block_6.out0, value=code_block_6.out1)
element = Revit.LinkElement.Element(linkElement=filterByBoolMask.in)
code_block_7 = CodeBlock { "Elevação do nível"; }
getParameterValueByName = Element.GetParameterValueByName(element=element, parameterName=code_block_7)
code_block_8 = CodeBlock(a=getParameterValueByName) { "Elevação do Ponto"; a; b = 3.25; c = a+b; }
setParameterByName_3 = Element.SetParameterByName(element=byPointAndLevel, parameterName=code_block_8.out0, value=code_block_8.c)
code_block_9 = CodeBlock { "Legenda do Ponto de Tomada"; "EM"; }
setParameterByName_4 = Element.SetParameterByName(element=byPointAndLevel, parameterName=code_block_9.out0, value=code_block_9.out1)
uniqueItems = List.UniqueItems(list=element_level)
n4_nível_para_inserir_no_projeto = Levels("Nível 1")  # "4. NÍVEL PARA INSERIR NO PROJETO ELÉTRICO"; graph input
eq_2 = element_level == n4_nível_para_inserir_no_projeto
name_3 = Level.Name(level=n4_nível_para_inserir_no_projeto)
string_from_object = FromObject(object=n4_nível_para_inserir_no_projeto)
name_4 = Level.Name(level=n4_nível_para_inserir_no_projeto)
filterByBoolMask_3 = List.FilterByBoolMask()  # unwired: list, mask
select_model_element = DSModelElementSelection()  # 1 picked in the model
select_model_element_2 = DSModelElementSelection()  # nothing selected
python_script_6 = Python()  # IronPython2; frozen; unwired: IN[0]
# ---------- python_script_6.python (103 lines) ----------
# TEMPLATE Python Script by BIM Coder
# Versão 1.0 - 08/24

#---IMPORTAÇÕES
# Sistema e .NET
import clr
import System
from System import Array
from System.Collections.Generic import *

# Biblioteca de Geometria do Dynamo
clr.AddReference('ProtoGeometry')
from Autodesk.DesignScript.Geometry import *

# Nós do Dynamo
clr.AddReference('RevitNodes')
import Revit
clr.ImportExtensions(Revit.Elements)
clr.ImportExtensions(Revit.GeometryConversion)

# Documentos e Transações
clr.AddReference('RevitServices')
import RevitServices
from RevitServices.Persistence import DocumentManager
from RevitServices.Transactions import TransactionManager

# DB da API do Revit
import Autodesk
clr.AddReference('RevitAPI')
from Autodesk.Revit.DB import *

# Interface do usuário da API do Revit
clr.AddReference('RevitAPIUI')
from Autodesk.Revit.UI import *
from Autodesk.Revit.UI.Selection import ObjectType

# Documentos e Interfaces
doc = DocumentManager.Instance.CurrentDBDocument
uiapp = DocumentManager.Instance.CurrentUIApplication
app = uiapp.Application
uidoc = uiapp.ActiveUIDocument

#---FUNÇÕES

# Função para obter a unidade de comprimento
def get_length_unit_format(doc):
    # Obtendo as unidades do documento
    units = doc.GetUnits()

    # Acessando as opções de formato para o comprimento
    format_options = units.GetFormatOptions(SpecTypeId.Length)

    # Obtendo o ID da unidade de comprimento atual
    unit_type_id = format_options.GetUnitTypeId()

    # Retornando a unidade de comprimento atual
    return unit_type_id

# Função para definir a unidade de comprimento para centímetros
def set_length_unit_to_centimeters(doc):
    # Iniciando uma transação para modificar as unidades
    TransactionManager.Instance.EnsureInTransaction(doc)

    # Obtendo as unidades atuais
    units = doc.GetUnits()

    # Criando novas opções de formato para definir como centímetros
    format_options = FormatOptions(UnitTypeId.Centimeters)

    # Definindo as opções para o comprimento (Length)
    units.SetFormatOptions(SpecTypeId.Length, format_options)

    # Aplicando as mudanças ao documento
    doc.SetUnits(units)

    # Finalizando a transação
    TransactionManager.Instance.TransactionTaskDone()

#---SCRIPT PRINCIPAL

# Primeiro, alteramos a unidade para centímetros
length_unit = get_length_unit_format(doc)

# Se a unidade não for centímetros, altere-a
if length_unit != UnitTypeId.Centimeters:
    set_length_unit_to_centimeters(doc)
    result = "Unidade alterada para Centímetros"
else:
    result = "A unidade já está em Centímetros"

# Agora, solicitamos ao usuário que selecione um elemento
try:
    # Solicitar ao usuário que selecione um objeto do tipo Element (por exemplo, paredes, janelas, etc.)
    selected_reference = uidoc.Selection.PickObject(ObjectType.Element)
    # Obter o elemento a partir da referência
    selected_element = uidoc.Document.GetElement(selected_reference)

    # Saída para o Dynamo (elemento Revit selecionado e mensagem sobre a unidade)
    OUT = (selected_element, result)

except Exception as e:
    # Se houver um erro (como se o usuário cancelar a seleção), retornar uma mensagem de erro
    OUT = str(e)
# ----------------------------------------
watch = Watch(n4_nível_para_inserir_no_projeto)
watch_2 = Watch(filterByBoolMask_2.in)
element_2 = Revit.LinkElement.Element(linkElement=ofCategory)
python_script_7 = Python(IN[0]=code_block_3)  # IronPython2; frozen
# ---------- python_script_7.python (82 lines) ----------
import clr
clr.AddReference('System.Windows.Forms')
clr.AddReference('System.Drawing')

from System.Windows.Forms import Application, Form, Label, TextBox, Button, FormStartPosition
from System.Drawing import Point, Size, Color

class LevelSelectionForm(Form):
    def __init__(self, levels, theme='Dark'):
        # Configurações do Formulário
        self.Text = "Selecione um Nível"
        self.Size = Size(290, 320)
        self.StartPosition = FormStartPosition.CenterScreen
        self.ShowIcon = False
        self.MaximizeBox = False
        self.MinimizeBox = False

        # Configuração do tema
        if theme == 'Light':
            self.BackColor = Color.White
            self.ForeColor = Color.Black
        else:
            self.BackColor = Color.FromArgb(45, 45, 48)  # Dark theme
            self.ForeColor = Color.White

        self.create_form(levels)
        self.create_ok_button()

    def create_form(self, levels):
        """Cria a Label e a TextBox para o usuário inserir o nível desejado."""
        lbl = Label()
        lbl.Text = "Níveis disponíveis:\n\nDigite o número referente ao nível desejado"
        lbl.Location = Point(20, 30)
        lbl.Size = Size(230, 50)
        self.Controls.Add(lbl)

        # Adiciona os níveis em uma label
        levels_text = "\n".join(levels)
        levels_label = Label()
        levels_label.Text = levels_text
        levels_label.Location = Point(20, 80)
        levels_label.Size = Size(200, 100)
        self.Controls.Add(levels_label)

        self.txt_input = TextBox()
        self.txt_input.Location = Point(20, 200)
        self.txt_input.Size = Size(230, 30)
        self.Controls.Add(self.txt_input)

    def create_ok_button(self):
        """Cria o botão OK para capturar a seleção e fechar o formulário."""
        btn_ok = Button()
        btn_ok.Text = "OK"
        btn_ok.Location = Point((self.ClientSize.Width - 100) // 2, 240)
        btn_ok.Size = Size(90, 30)
        btn_ok.Click += self.on_ok
        self.Controls.Add(btn_ok)

    def on_ok(self, sender, event):
        """Captura o texto digitado, verifica e fecha o formulário."""
        user_input = self.txt_input.Text.strip()  # Obtém o texto do usuário
        self.user_selection = None  # Inicializa a seleção

        # Verifica se o input do usuário coincide com o início de algum nível
        for level in levels:
            if level.startswith(user_input):
                # Remove o sufixo numérico (tudo antes do " - ") apenas na saída
                self.user_selection = level.split(" - ", 1)[-1]
                break

        self.Close()

# Exemplo de níveis passados como entrada (substitua por IN[0] no Dynamo)
levels = IN[0]  # Exemplo de nomes de níveis já numerados

# Criação do formulário
theme = "Dark"  # Você pode mudar para "Light" se quiser o tema claro
form = LevelSelectionForm(levels, theme)
Application.Run(form)

# O nível selecionado pelo usuário será armazenado na variável 'form.user_selection'
OUT = form.user_selection
# ----------------------------------------
python_script_8 = Python()  # IronPython2; frozen; unwired: IN[0]
# ---------- python_script_8.python (57 lines) ----------
#TEMPLATE Python Script by BIM Coder
#Versão 1.0 - 08/24

#---IMPORTAÇÕES
# Sistema e .NET
import clr
import System
from System import Array
from System.Collections.Generic import *

# Biblioteca de Geometria do Dynamo
clr.AddReference('ProtoGeometry')
from Autodesk.DesignScript.Geometry import *

# Nós do Dynamo
clr.AddReference('RevitNodes')
import Revit
clr.ImportExtensions(Revit.Elements)
clr.ImportExtensions(Revit.GeometryConversion)

# Documentos e Transações
clr.AddReference('RevitServices')
import RevitServices
from RevitServices.Persistence import DocumentManager
from RevitServices.Transactions import TransactionManager

# DB da API do Revit
import Autodesk
clr.AddReference('RevitAPI')
from Autodesk.Revit.DB import *

# Interface do usuário da API do Revit
clr.AddReference('RevitAPIUI')
from Autodesk.Revit.UI import *

from Autodesk.Revit.UI.Selection import ObjectType

# Documentos e Interfaces
doc = DocumentManager.Instance.CurrentDBDocument
uiapp = DocumentManager.Instance.CurrentUIApplication
app = uiapp.Application
uidoc = uiapp.ActiveUIDocument

#---SCRIPT

# Solicitar ao usuário que selecione um objeto do tipo Element (por exemplo, paredes, janelas, etc.)
try:
    selected_reference = uidoc.Selection.PickObject(ObjectType.Element)
    # Obter o elemento a partir da referência
    selected_element = uidoc.Document.GetElement(selected_reference)

    # Saída para o Dynamo (elemento Revit selecionado)
    OUT = selected_element

except Exception as e:
    # Se houver um erro (como se o usuário cancelar a seleção), retornar uma mensagem de erro
    OUT = str(e)
# ----------------------------------------
python_script_9 = Python()  # IronPython2; frozen; unwired: IN[0]
# ---------- python_script_9.python (58 lines) ----------
# Importando as bibliotecas do Revit
import clr
clr.AddReference("RevitServices")
from RevitServices.Persistence import DocumentManager
from RevitServices.Transactions import TransactionManager

clr.AddReference("RevitAPI")
from Autodesk.Revit.DB import *

# Obtendo o documento atual do Revit
doc = DocumentManager.Instance.CurrentDBDocument

# Função para obter a unidade de comprimento
def get_length_unit_format(doc):
    # Obtendo as unidades do documento
    units = doc.GetUnits()

    # Acessando as opções de formato para o comprimento
    format_options = units.GetFormatOptions(SpecTypeId.Length)

    # Obtendo o ID da unidade de comprimento atual
    unit_type_id = format_options.GetUnitTypeId()

    # Retornando a unidade de comprimento atual
    return unit_type_id

# Função para definir a unidade de comprimento para centímetros
def set_length_unit_to_centimeters(doc):
    # Iniciando uma transação para modificar as unidades
    TransactionManager.Instance.EnsureInTransaction(doc)

    # Obtendo as unidades atuais
    units = doc.GetUnits()

    # Criando novas opções de formato para definir como centímetros
    format_options = FormatOptions(UnitTypeId.Centimeters)

    # Definindo as opções para o comprimento (Length)
    units.SetFormatOptions(SpecTypeId.Length, format_options)

    # Aplicando as mudanças ao documento
    doc.SetUnits(units)

    # Finalizando a transação
    TransactionManager.Instance.TransactionTaskDone()

# Obtendo a unidade de comprimento atual
length_unit = get_length_unit_format(doc)

# Verificando se a unidade não é centímetros e mudando se necessário
if length_unit != UnitTypeId.Centimeters:
    set_length_unit_to_centimeters(doc)
    result = "Unidade alterada para Centímetros"
else:
    result = "A unidade já está em Centímetros"

# Retornar a unidade para o Dynamo
OUT = result
# ----------------------------------------
python_script_10 = Python(IN[0]=python_script_9)  # IronPython2; same code as python_script_8
python_script_11 = Python()  # IronPython2; frozen; unwired: IN[0]
# ---------- python_script_11.python (65 lines) ----------
# Importando as bibliotecas do Revit e Windows Forms
import clr
clr.AddReference("RevitServices")
from RevitServices.Persistence import DocumentManager
from RevitServices.Transactions import TransactionManager

clr.AddReference("RevitAPI")
from Autodesk.Revit.DB import *

# Adicionando referência para System.Windows.Forms
clr.AddReference("System.Windows.Forms")
from System.Windows.Forms import MessageBox, MessageBoxButtons

# Obtendo o documento atual do Revit
doc = DocumentManager.Instance.CurrentDBDocument

# Função para obter a unidade de comprimento
def get_length_unit_format(doc):
    # Obtendo as unidades do documento
    units = doc.GetUnits()

    # Acessando as opções de formato para o comprimento
    format_options = units.GetFormatOptions(SpecTypeId.Length)

    # Obtendo o ID da unidade de comprimento atual
    unit_type_id = format_options.GetUnitTypeId()

    # Retornando a unidade de comprimento atual
    return unit_type_id

# Função para definir a unidade de comprimento para centímetros
def set_length_unit_to_centimeters(doc):
    # Iniciando uma transação para modificar as unidades
    TransactionManager.Instance.EnsureInTransaction(doc)

    # Obtendo as unidades atuais
    units = doc.GetUnits()

    # Criando novas opções de formato para definir como centímetros
    format_options = FormatOptions(UnitTypeId.Centimeters)

    # Definindo as opções para o comprimento (Length)
    units.SetFormatOptions(SpecTypeId.Length, format_options)

    # Aplicando as mudanças ao documento
    doc.SetUnits(units)

    # Finalizando a transação
    TransactionManager.Instance.TransactionTaskDone()

# Obtendo a unidade de comprimento atual
length_unit = get_length_unit_format(doc)

# Verificando se a unidade não é centímetros e mudando se necessário
if length_unit != UnitTypeId.Centimeters:
    set_length_unit_to_centimeters(doc)
    result = "Unidade alterada para Centímetros"
else:
    result = "A unidade já está em Centímetros"

# Exibir uma janela pop-up para o usuário confirmar a mensagem
MessageBox.Show(result, "Confirmação", MessageBoxButtons.OK)

# Retornar 1 para o Dynamo após o usuário clicar em OK
OUT = 1
# ----------------------------------------
python_script_12 = Python()  # IronPython2; frozen; unwired: IN[0]; same code as python_script_11
