# Dynamo graph INSTALACAO ELETRODUTO_script.dyn (Dynamo 2.13.1.3887)

seleção_dos_elementos = Python()  # IronPython2; unwired: IN[0]
# ---------- seleção_dos_elementos.python (57 lines) ----------
#TEMPLATE Python Script by BIM Coder
#Versão 1.0 - 08/24

#---IMPORTAÇÕES
# Sistema e .NET
import clr
import sys
import System
from System import Array
from System.Collections.Generic import *

# Biblioteca de Geometria do Dynamo
clr.AddReference('ProtoGeometry')
from Autodesk.DesignScript.Geometry import *

# Nós do Dynamo
clr.AddReference('RevitNodes')
import Revit
clr.ImportExtensions(Revit.Elements)
clr.ImportExtensions(Revit.GeometryConversion)

# Documentos e Transações
clr.AddReference('RevitServices')
import RevitServices
from RevitServices.Persistence import DocumentManager
from RevitServices.Transactions import TransactionManager

# DB da API do Revit
import Autodesk
clr.AddReference('RevitAPI')
from Autodesk.Revit.DB import *

# Interface do usuário da API do Revit
clr.AddReference('RevitAPIUI')
from Autodesk.Revit.UI import *

from Autodesk.Revit.UI.Selection import ObjectType

# Documentos e Interfaces
doc = DocumentManager.Instance.CurrentDBDocument
uiapp = DocumentManager.Instance.CurrentUIApplication
app = uiapp.Application
uidoc = uiapp.ActiveUIDocument

#---CLASSES E FUNÇÕES

#---SCRIPT

# Solicitar ao usuário que selecione múltiplos objetos do tipo Element (por exemplo, paredes, janelas, etc.)

selected_references = uidoc.Selection.PickObjects(ObjectType.Element)

# Obter os elementos a partir das referências
selected_elements = [uidoc.Document.GetElement(reference) for reference in selected_references]

# Saída para o Dynamo (lista de elementos Revit)
OUT = selected_elements
# ----------------------------------------
getCategory = Element.GetCategory(element=seleção_dos_elementos)
string_from_object = FromObject(object=getCategory)
code_block = CodeBlock { "Conduites"; }
eq = string_from_object == code_block
filterByBoolMask = List.FilterByBoolMask(list=seleção_dos_elementos, mask=eq)
name = Family.Name(family=filterByBoolMask.out)
string = StringInput("Curva")
contains = String.Contains(string=name, searchFor=string)
filterByBoolMask_2 = List.FilterByBoolMask(list=filterByBoolMask.out, mask=contains)
list_create = List.Create(item0=filterByBoolMask.in, item1=filterByBoolMask_2.in)
flatten = List.Flatten(list=list_create)
TEXTO = Python()  # IronPython2; unwired: IN[0]
# ---------- TEXTO.python (62 lines) ----------
import clr
clr.AddReference('System.Windows.Forms')
clr.AddReference('System.Drawing')

from System.Windows.Forms import Application, Form, Label, TextBox, Button, FormStartPosition
from System.Drawing import Point, Size, Color

class MyForm(Form):
    def __init__(self, theme='Dark'):
        # Configurações do Formulário
        self.Text = "Parâmetro ORÇAMENTO INSTALAÇÃO ELETRODUTO"
        self.Size = Size(350, 200)
        self.StartPosition = FormStartPosition.CenterScreen
        self.ShowIcon = False
        self.MaximizeBox = False
        self.MinimizeBox = False

        # Configuração do tema
        if theme == 'Light':
            self.BackColor = Color.White
            self.ForeColor = Color.Black
        else:
            self.BackColor = Color.FromArgb(45, 45, 48)  # Dark theme
            self.ForeColor = Color.White

        self.create_form()
        self.create_ok_button()

    def create_form(self):
        """Cria a Label e o campo de entrada de texto."""
        lbl = Label()
        lbl.Text = "Digite o texto:"
        lbl.Location = Point(20, 20)
        lbl.Size = Size(150, 30)
        self.Controls.Add(lbl)

        self.txt_input = TextBox()
        self.txt_input.Location = Point(20, 50)
        self.txt_input.Size = Size(240, 30)
        self.Controls.Add(self.txt_input)

    def create_ok_button(self):
        """Cria o botão OK para capturar o texto e fechar o formulário."""
        btn_ok = Button()
        btn_ok.Text = "OK"
        btn_ok.Location = Point((self.ClientSize.Width - 100) // 2, 90)
        btn_ok.Size = Size(100, 30)
        btn_ok.Click += self.on_ok
        self.Controls.Add(btn_ok)

    def on_ok(self, sender, event):
        """Captura o texto digitado e fecha o formulário."""
        self.user_input = self.txt_input.Text
        self.Close()

# Criação do formulário
theme = "Dark"  # Você pode mudar para "Light" se quiser o tema claro
form = MyForm(theme)
Application.Run(form)

# O texto inserido pelo usuário será armazenado na variável 'form.user_input'
OUT = form.user_input
# ----------------------------------------
preencher_o_parametro = Python(IN[0]=flatten, IN[1]=TEXTO)  # IronPython2
# ---------- preencher_o_parametro.python (30 lines) ----------
import clr
clr.AddReference('RevitServices')
clr.AddReference('RevitAPI')
clr.AddReference('RevitAPIUI')

from RevitServices.Persistence import DocumentManager
from RevitServices.Transactions import TransactionManager
from Autodesk.Revit.DB import Element

# Obter o documento ativo do Revit
doc = DocumentManager.Instance.CurrentDBDocument

# Obter os elementos selecionados a partir de IN[0] e o texto da IN[1]
elements = UnwrapElement(IN[0])  # Desembrulha os elementos do Dynamo
text_to_set = IN[1]  # Texto a ser inserido no parâmetro "ORÇAMENTO INSTALAÇÃO ELETRODUTO"

# Iniciar uma transação para modificar os parâmetros no Revit
TransactionManager.Instance.EnsureInTransaction(doc)

# Iterar sobre os elementos e definir o valor no parâmetro "ORÇAMENTO INSTALAÇÃO ELETRODUTO"
for element in elements:
    marca_param = element.LookupParameter("ORÇAMENTO INSTALAÇÃO ELETRODUTO")
    if marca_param and not marca_param.IsReadOnly:
        marca_param.Set(text_to_set)

# Finalizar a transação
TransactionManager.Instance.TransactionTaskDone()

# Saída
OUT = "Texto atualizado no parâmetro 'ORÇAMENTO INSTALAÇÃO ELETRODUTO' para {} elementos.".format(len(elements))
# ----------------------------------------
python_script = Python(IN[0]=filterByBoolMask_2.in)  # IronPython2
# ---------- python_script.python (34 lines) ----------
# Importando bibliotecas necessárias
import clr
clr.AddReference('RevitAPI')
clr.AddReference('RevitServices')
from RevitServices.Persistence import DocumentManager
from Autodesk.Revit.DB import ElementId, FilteredElementCollector

# Obtendo o documento ativo do Revit
doc = DocumentManager.Instance.CurrentDBDocument

# Função para obter elementos filhos
def get_child_elements(element):
    child_elements = []
    
    # Coletor para buscar elementos
    collector = FilteredElementCollector(doc).WhereElementIsNotElementType()
    
    for el in collector:
        # Verifica se o elemento é filho do elemento pai (ajuste conforme a lógica necessária)
        if el.GetType() == element.GetType() and el.OwnerViewId == element.OwnerViewId:
            child_elements.append(el)
    
    return child_elements

# Processando a entrada (lista de elementos)
input_elements = UnwrapElement(IN[0])  # IN[0] é a entrada da lista de elementos
all_child_elements = []

for elem in input_elements:
    children = get_child_elements(elem)
    all_child_elements.extend(children)  # Adiciona os filhos à lista principal

# Saída: lista única de todos os elementos filhos
OUT = all_child_elements
# ----------------------------------------
