# Dynamo graph LOCALIZAÇÃOH_script.dyn "LOCALIZAÇÃO_script - Copia" (Dynamo 2.13.1.3887)

seleção_dos_elementos = Python()  # IronPython2; frozen; unwired: IN[0]
# ---------- seleção_dos_elementos.python (57 lines) ----------
#TEMPLATE Python Script by BIM Coder
#Versão 1.0 - 08/24

#---IMPORTAÇÕES
# Sistema e .NET
import clr
import sys
import System
from System import Array
from System.Collections.Generic import *

# Biblioteca de Geometria do Dynamo
clr.AddReference('ProtoGeometry')
from Autodesk.DesignScript.Geometry import *

# Nós do Dynamo
clr.AddReference('RevitNodes')
import Revit
clr.ImportExtensions(Revit.Elements)
clr.ImportExtensions(Revit.GeometryConversion)

# Documentos e Transações
clr.AddReference('RevitServices')
import RevitServices
from RevitServices.Persistence import DocumentManager
from RevitServices.Transactions import TransactionManager

# DB da API do Revit
import Autodesk
clr.AddReference('RevitAPI')
from Autodesk.Revit.DB import *

# Interface do usuário da API do Revit
clr.AddReference('RevitAPIUI')
from Autodesk.Revit.UI import *

from Autodesk.Revit.UI.Selection import ObjectType

# Documentos e Interfaces
doc = DocumentManager.Instance.CurrentDBDocument
uiapp = DocumentManager.Instance.CurrentUIApplication
app = uiapp.Application
uidoc = uiapp.ActiveUIDocument

#---CLASSES E FUNÇÕES

#---SCRIPT

# Solicitar ao usuário que selecione múltiplos objetos do tipo Element (por exemplo, paredes, janelas, etc.)

selected_references = uidoc.Selection.PickObjects(ObjectType.Element)

# Obter os elementos a partir das referências
selected_elements = [uidoc.Document.GetElement(reference) for reference in selected_references]

# Saída para o Dynamo (lista de elementos Revit)
OUT = selected_elements
# ----------------------------------------
getChildElements = Element.GetChildElements(element=seleção_dos_elementos)
flatten = List.Flatten(list=getChildElements)
list_create = List.Create(item0=seleção_dos_elementos, item1=flatten)
flatten_2 = List.Flatten(list=list_create)
TEXTO = Python()  # IronPython2; frozen; unwired: IN[0]
# ---------- TEXTO.python (62 lines) ----------
import clr
clr.AddReference('System.Windows.Forms')
clr.AddReference('System.Drawing')

from System.Windows.Forms import Application, Form, Label, TextBox, Button, FormStartPosition
from System.Drawing import Point, Size, Color

class MyForm(Form):
    def __init__(self, theme='Dark'):
        # Configurações do Formulário
        self.Text = "Parâmetro ORÇAMENTO LOCALIZAÇÃO"
        self.Size = Size(350, 200)
        self.StartPosition = FormStartPosition.CenterScreen
        self.ShowIcon = False
        self.MaximizeBox = False
        self.MinimizeBox = False

        # Configuração do tema
        if theme == 'Light':
            self.BackColor = Color.White
            self.ForeColor = Color.Black
        else:
            self.BackColor = Color.FromArgb(45, 45, 48)  # Dark theme
            self.ForeColor = Color.White

        self.create_form()
        self.create_ok_button()

    def create_form(self):
        """Cria a Label e o campo de entrada de texto."""
        lbl = Label()
        lbl.Text = "Digite o texto:"
        lbl.Location = Point(20, 20)
        lbl.Size = Size(150, 30)
        self.Controls.Add(lbl)

        self.txt_input = TextBox()
        self.txt_input.Location = Point(20, 50)
        self.txt_input.Size = Size(240, 30)
        self.Controls.Add(self.txt_input)

    def create_ok_button(self):
        """Cria o botão OK para capturar o texto e fechar o formulário."""
        btn_ok = Button()
        btn_ok.Text = "OK"
        btn_ok.Location = Point((self.ClientSize.Width - 100) // 2, 90)
        btn_ok.Size = Size(100, 30)
        btn_ok.Click += self.on_ok
        self.Controls.Add(btn_ok)

    def on_ok(self, sender, event):
        """Captura o texto digitado e fecha o formulário."""
        self.user_input = self.txt_input.Text
        self.Close()

# Criação do formulário
theme = "Dark"  # Você pode mudar para "Light" se quiser o tema claro
form = MyForm(theme)
Application.Run(form)

# O texto inserido pelo usuário será armazenado na variável 'form.user_input'
OUT = form.user_input
# ----------------------------------------
preencher_o_parametro = Python(IN[0]=flatten_2, IN[1]=TEXTO)  # IronPython2
# ---------- preencher_o_parametro.python (30 lines) ----------
import clr
clr.AddReference('RevitServices')
clr.AddReference('RevitAPI')
clr.AddReference('RevitAPIUI')

from RevitServices.Persistence import DocumentManager
from RevitServices.Transactions import TransactionManager
from Autodesk.Revit.DB import Element

# Obter o documento ativo do Revit
doc = DocumentManager.Instance.CurrentDBDocument

# Obter os elementos selecionados a partir de IN[0] e o texto da IN[1]
elements = UnwrapElement(IN[0])  # Desembrulha os elementos do Dynamo
text_to_set = IN[1]  # Texto a ser inserido no parâmetro "ORÇAMENTO LOCALIZAÇÃO"

# Iniciar uma transação para modificar os parâmetros no Revit
TransactionManager.Instance.EnsureInTransaction(doc)

# Iterar sobre os elementos e definir o valor no parâmetro "ORÇAMENTO LOCALIZAÇÃO"
for element in elements:
    marca_param = element.LookupParameter("ORÇAMENTO LOCALIZAÇÃO")
    if marca_param and not marca_param.IsReadOnly:
        marca_param.Set(text_to_set)

# Finalizar a transação
TransactionManager.Instance.TransactionTaskDone()

# Saída
OUT = "Texto atualizado no parâmetro 'ORÇAMENTO LOCALIZAÇÃO' para {} elementos.".format(len(elements))
# ----------------------------------------
seleção_dos_elementos_2 = Python()  # IronPython2; unwired: IN[0]; same code as seleção_dos_elementos
getChildElements_2 = Element.GetChildElements(element=seleção_dos_elementos_2, lacing=Longest)
flatten_3 = List.Flatten(list=getChildElements_2)
isNull = Object.IsNull(object=flatten_3)
filterByBoolMask = List.FilterByBoolMask(list=seleção_dos_elementos_2, mask=isNull)
list_create_2 = List.Create(item0=getChildElements_2, item1=filterByBoolMask.in)
flatten_4 = List.Flatten(list=list_create_2)
isNull_2 = Object.IsNull(object=flatten_4)
filterByBoolMask_2 = List.FilterByBoolMask(list=flatten_4, mask=isNull_2)
TEXTO_2 = Python()  # IronPython2; unwired: IN[0]; same code as TEXTO
preencher_o_parametro_2 = Python(IN[0]=filterByBoolMask_2.out, IN[1]=TEXTO_2)  # IronPython2; same code as preencher_o_parametro
id = Element.Id(element=filterByBoolMask_2.out, lacing=Longest)
code_block = CodeBlock { 8513803; }
eq = id == code_block
filterByBoolMask_3 = List.FilterByBoolMask(list=id, mask=eq)
