# Dynamo graph TIPO DE SISTEMA_script.dyn (Dynamo 2.13.1.3887)

TEXTO = Python()  # IronPython2; frozen; unwired: IN[0]
# ---------- TEXTO.python (62 lines) ----------
import clr
clr.AddReference('System.Windows.Forms')
clr.AddReference('System.Drawing')

from System.Windows.Forms import Application, Form, Label, TextBox, Button, FormStartPosition
from System.Drawing import Point, Size, Color

class MyForm(Form):
    def __init__(self, theme='Dark'):
        # Configurações do Formulário
        self.Text = "Parâmetro ORÇAMENTO TIPO DE SISTEMA"
        self.Size = Size(350, 200)
        self.StartPosition = FormStartPosition.CenterScreen
        self.ShowIcon = False
        self.MaximizeBox = False
        self.MinimizeBox = False

        # Configuração do tema
        if theme == 'Light':
            self.BackColor = Color.White
            self.ForeColor = Color.Black
        else:
            self.BackColor = Color.FromArgb(45, 45, 48)  # Dark theme
            self.ForeColor = Color.White

        self.create_form()
        self.create_ok_button()

    def create_form(self):
        """Cria a Label e o campo de entrada de texto."""
        lbl = Label()
        lbl.Text = "Digite o texto:"
        lbl.Location = Point(20, 20)
        lbl.Size = Size(150, 30)
        self.Controls.Add(lbl)

        self.txt_input = TextBox()
        self.txt_input.Location = Point(20, 50)
        self.txt_input.Size = Size(240, 30)
        self.Controls.Add(self.txt_input)

    def create_ok_button(self):
        """Cria o botão OK para capturar o texto e fechar o formulário."""
        btn_ok = Button()
        btn_ok.Text = "OK"
        btn_ok.Location = Point((self.ClientSize.Width - 100) // 2, 90)
        btn_ok.Size = Size(100, 30)
        btn_ok.Click += self.on_ok
        self.Controls.Add(btn_ok)

    def on_ok(self, sender, event):
        """Captura o texto digitado e fecha o formulário."""
        self.user_input = self.txt_input.Text
        self.Close()

# Criação do formulário
theme = "Dark"  # Você pode mudar para "Light" se quiser o tema claro
form = MyForm(theme)
Application.Run(form)

# O texto inserido pelo usuário será armazenado na variável 'form.user_input'
OUT = form.user_input
# ----------------------------------------
seleção_dos_elementos = Python()  # IronPython2; unwired: IN[0]
# ---------- seleção_dos_elementos.python (57 lines) ----------
#TEMPLATE Python Script by BIM Coder
#Versão 1.0 - 08/24

#---IMPORTAÇÕES
# Sistema e .NET
import clr
import sys
import System
from System import Array
from System.Collections.Generic import *

# Biblioteca de Geometria do Dynamo
clr.AddReference('ProtoGeometry')
from Autodesk.DesignScript.Geometry import *

# Nós do Dynamo
clr.AddReference('RevitNodes')
import Revit
clr.ImportExtensions(Revit.Elements)
clr.ImportExtensions(Revit.GeometryConversion)

# Documentos e Transações
clr.AddReference('RevitServices')
import RevitServices
from RevitServices.Persistence import DocumentManager
from RevitServices.Transactions import TransactionManager

# DB da API do Revit
import Autodesk
clr.AddReference('RevitAPI')
from Autodesk.Revit.DB import *

# Interface do usuário da API do Revit
clr.AddReference('RevitAPIUI')
from Autodesk.Revit.UI import *

from Autodesk.Revit.UI.Selection import ObjectType

# Documentos e Interfaces
doc = DocumentManager.Instance.CurrentDBDocument
uiapp = DocumentManager.Instance.CurrentUIApplication
app = uiapp.Application
uidoc = uiapp.ActiveUIDocument

#---CLASSES E FUNÇÕES

#---SCRIPT

# Solicitar ao usuário que selecione múltiplos objetos do tipo Element (por exemplo, paredes, janelas, etc.)

selected_references = uidoc.Selection.PickObjects(ObjectType.Element)

# Obter os elementos a partir das referências
selected_elements = [uidoc.Document.GetElement(reference) for reference in selected_references]

# Saída para o Dynamo (lista de elementos Revit)
OUT = selected_elements
# ----------------------------------------
python_script = Python(IN[0]=seleção_dos_elementos)  # IronPython2
# ---------- python_script.python (34 lines) ----------
# Importando bibliotecas necessárias
import clr
clr.AddReference('RevitAPI')
clr.AddReference('RevitServices')
from RevitServices.Persistence import DocumentManager
from Autodesk.Revit.DB import ElementId, FilteredElementCollector

# Obtendo o documento ativo do Revit
doc = DocumentManager.Instance.CurrentDBDocument

# Função para obter elementos filhos
def get_child_elements(element):
    child_elements = []
    
    # Coletor para buscar elementos
    collector = FilteredElementCollector(doc).WhereElementIsNotElementType()
    
    for el in collector:
        # Verifica se o elemento é filho do elemento pai (ajuste conforme a lógica necessária)
        if el.GetType() == element.GetType() and el.OwnerViewId == element.OwnerViewId:
            child_elements.append(el)
    
    return child_elements

# Processando a entrada (lista de elementos)
input_elements = UnwrapElement(IN[0])  # IN[0] é a entrada da lista de elementos
all_child_elements = []

for elem in input_elements:
    children = get_child_elements(elem)
    all_child_elements.extend(children)  # Adiciona os filhos à lista principal

# Saída: lista única de todos os elementos filhos
OUT = all_child_elements
# ----------------------------------------
TEXTO_2 = Python()  # IronPython2; unwired: IN[0]
# ---------- TEXTO_2.python (99 lines) ----------
import clr
clr.AddReference('System.Windows.Forms')
clr.AddReference('System.Drawing')

from System.Windows.Forms import Application, Form, Label, TextBox, Button, FormStartPosition, MessageBox, MessageBoxButtons, MessageBoxIcon
from System.Drawing import Point, Size, Color

class MyForm(Form):
    def __init__(self, theme='Dark'):
        # Configurações do Formulário
        self.Text = "Parâmetro ORÇAMENTO TIPO DE SISTEMA"
        self.Size = Size(300, 350)  # Aumentado para melhor disposição
        self.StartPosition = FormStartPosition.CenterScreen
        self.ShowIcon = False
        self.MaximizeBox = False
        self.MinimizeBox = False

        # Configuração do tema
        if theme == 'Light':
            self.BackColor = Color.White
            self.ForeColor = Color.Black
        else:
            self.BackColor = Color.FromArgb(45, 45, 48)  # Tema escuro
            self.ForeColor = Color.White

        self.create_form()
        self.create_ok_button()

    def create_form(self):
        """Cria a Label com as opções e o campo de entrada de texto."""
        lbl_options = Label()
        lbl_options.Text = ("\nEscolha uma opção:\n\n"
                            "1 - ARQUITETURA\n"
                            "2 - AUTOMACAO\n"
                            "3 - CABEAMENTO ESTRUTURADO\n"
                            "4 - CFTV\n"
                            "5 - ELETRICO\n"
                            "6 - EST. CONCRETO\n"
                            "7 - EST. METALICA\n"
                            "8 - HIDRAULICO\n"
                            "9 - INCENDIO\n"
                            "10 - LUMINOTECNICO\n"
                            "11 - SDAI\n"
                            "12 - SPDA")
        lbl_options.Location = Point(20, 20)
        lbl_options.Size = Size(330, 160)
        lbl_options.AutoSize = True
        self.Controls.Add(lbl_options)

        self.txt_input = TextBox()
        self.txt_input.Location = Point(20, 220)
        self.txt_input.Size = Size(200, 30)
        self.Controls.Add(self.txt_input)

    def create_ok_button(self):
        """Cria o botão OK para capturar o texto e fechar o formulário."""
        btn_ok = Button()
        btn_ok.Text = "OK"
        btn_ok.Location = Point((self.ClientSize.Width - 100) // 2, 260)
        btn_ok.Size = Size(100, 30)
        btn_ok.Click += self.on_ok
        self.Controls.Add(btn_ok)

    def on_ok(self, sender, event):
        """Captura o texto digitado e fecha o formulário se válido."""
        options = {
            1: "ARQUITETURA",
            2: "AUTOMACAO",
            3: "CABEAMENTO ESTRUTURADO",
            4: "CFTV",
            5: "ELETRICO",
            6: "EST. CONCRETO",
            7: "EST. METALICA",
            8: "HIDRAULICO",
            9: "INCENDIO",
            10: "LUMINOTECNICO",
            11: "SDAI",
            12: "SPDA"
        }

        try:
            input_value = int(self.txt_input.Text)
            if input_value in options:
                self.user_input = options[input_value]
                self.Close()  # Fecha o formulário apenas se a entrada for válida
            else:
                self.user_input = None
                MessageBox.Show("Por favor, escolha uma opção válida (1-12).", "Erro", MessageBoxButtons.OK, MessageBoxIcon.Error)
        except ValueError:
            self.user_input = None
            MessageBox.Show("Por favor, insira um número válido.", "Erro", MessageBoxButtons.OK, MessageBoxIcon.Error)

# Criação do formulário
theme = "Dark"  # Você pode mudar para "Light" se quiser o tema claro
form = MyForm(theme)
Application.Run(form)

# O texto correspondente à opção escolhida será armazenado na variável 'OUT'
OUT = form.user_input
# ----------------------------------------
preencher_o_parametro = Python(IN[0]=python_script, IN[1]=TEXTO_2)  # IronPython2
# ---------- preencher_o_parametro.python (30 lines) ----------
import clr
clr.AddReference('RevitServices')
clr.AddReference('RevitAPI')
clr.AddReference('RevitAPIUI')

from RevitServices.Persistence import DocumentManager
from RevitServices.Transactions import TransactionManager
from Autodesk.Revit.DB import Element

# Obter o documento ativo do Revit
doc = DocumentManager.Instance.CurrentDBDocument

# Obter os elementos selecionados a partir de IN[0] e o texto da IN[1]
elements = UnwrapElement(IN[0])  # Desembrulha os elementos do Dynamo
text_to_set = IN[1]  # Texto a ser inserido no parâmetro "ORÇAMENTO TIPO DE SISTEMA"

# Iniciar uma transação para modificar os parâmetros no Revit
TransactionManager.Instance.EnsureInTransaction(doc)

# Iterar sobre os elementos e definir o valor no parâmetro "ORÇAMENTO TIPO DE SISTEMA"
for element in elements:
    marca_param = element.LookupParameter("ORÇAMENTO TIPO DE SISTEMA")
    if marca_param and not marca_param.IsReadOnly:
        marca_param.Set(text_to_set)

# Finalizar a transação
TransactionManager.Instance.TransactionTaskDone()

# Saída
OUT = "Texto atualizado no parâmetro 'ORÇAMENTO TIPO DE SISTEMA' para {} elementos.".format(len(elements))
# ----------------------------------------
TEXTO_3 = Python()  # IronPython2; frozen; unwired: IN[0]
# ---------- TEXTO_3.python (109 lines) ----------
import clr
clr.AddReference('System.Windows.Forms')
clr.AddReference('System.Drawing')

from System.Windows.Forms import Application, Form, Label, TextBox, Button, FormStartPosition
from System.Drawing import Point, Size, Color

class MyForm(Form):
    def __init__(self, theme='Dark'):
        # Configurações do Formulário
        self.Text = "Parâmetro ORÇAMENTO TIPO DE SISTEMA"
        self.Size = Size(300, 350)
        self.StartPosition = FormStartPosition.CenterScreen
        self.ShowIcon = False
        self.MaximizeBox = False
        self.MinimizeBox = False

        # Configuração do tema
        if theme == 'Light':
            self.BackColor = Color.White
            self.ForeColor = Color.Black
        else:
            self.BackColor = Color.FromArgb(45, 45, 48)  # Dark theme
            self.ForeColor = Color.White

        self.create_form()
        self.create_ok_button()

    def create_form(self):
        """Cria a Label com as opções e o campo de entrada de texto."""
        lbl_options = Label()
        lbl_options.Text = ("\nEscolha uma opção:\n\n"
                            "1 - ARQUITETURA\n"
                            "2 - AUTOMACAO\n"
                            "3 - CABEAMENTO ESTRUTURADO\n"
                            "4 - CFTV\n"
                            "5 - ELETRICO\n"
                            "6 - EST. CONCRETO\n"
                            "7 - EST. METALICA\n"
                            "8 - HIDRAULICO\n"
                            "9 - INCENDIO\n"
                            "10 - LUMINOTECNICO\n"
                            "11 - SDAI\n"
                            "12 - SPDA")
        lbl_options.Location = Point(20, 20)
        lbl_options.Size = Size(330, 160)
        lbl_options.AutoSize = True
        self.Controls.Add(lbl_options)

        self.txt_input = TextBox()
        self.txt_input.Location = Point(20, 220)
        self.txt_input.Size = Size(200, 30)
        self.Controls.Add(self.txt_input)

    def create_ok_button(self):
        """Cria o botão OK para capturar o texto e fechar o formulário."""
        btn_ok = Button()
        btn_ok.Text = "OK"
        btn_ok.Location = Point((self.ClientSize.Width - 100) // 2, 260)
        btn_ok.Size = Size(100, 30)
        btn_ok.Click += self.on_ok
        self.Controls.Add(btn_ok)

    def on_ok(self, sender, event):
        """Captura o texto digitado e fecha o formulário."""
        options = {
            1: "ARQUITETURA",
            2: "AUTOMACAO",
            3: "CABEAMENTO ESTRUTURADO",
            4: "CFTV",
            5: "ELETRICO",
            6: "EST. CONCRETO",
            7: "EST. METALICA",
            8: "HIDRAULICO",
            9: "INCENDIO",
            10: "LUMINOTECNICO",
            11: "SDAI",
            12: "SPDA"
        }

        try:
            input_value = int(self.txt_input.Text)
            if input_value in options:
                self.user_input = options[input_value]
            else:
                self.user_input = None
                self.show_error("Por favor, escolha uma opção válida (1-12).")
        except ValueError:
            self.user_input = None
            self.show_error("Por favor, insira um número válido.")

        self.Close()

    def show_error(self, message):
        """Exibe uma mensagem de erro."""
        error_label = Label()
        error_label.Text = message
        error_label.Location = Point(20, 260)
        error_label.Size = Size(300, 30)
        error_label.ForeColor = Color.Red
        self.Controls.Add(error_label)

# Criação do formulário
theme = "Dark"  # Você pode mudar para "Light" se quiser o tema claro
form = MyForm(theme)
Application.Run(form)

# O texto correspondente à opção escolhida será armazenado na variável 'form.user_input'
OUT = form.user_input
# ----------------------------------------
TEXTO_4 = Python()  # IronPython2; frozen; unwired: IN[0]
# ---------- TEXTO_4.python (93 lines) ----------
import clr
clr.AddReference('System.Windows.Forms')
clr.AddReference('System.Drawing')

from System.Windows.Forms import Application, Form, Label, TextBox, Button, FormStartPosition
from System.Drawing import Point, Size, Color

class MyForm(Form):
    def __init__(self, theme='Dark'):
        # Configurações do Formulário
        self.Text = "Parâmetro ORÇAMENTO TIPO DE SISTEMA"
        self.Size = Size(350, 300)
        self.StartPosition = FormStartPosition.CenterScreen
        self.ShowIcon = False
        self.MaximizeBox = False
        self.MinimizeBox = False

        # Configuração do tema
        if theme == 'Light':
            self.BackColor = Color.White
            self.ForeColor = Color.Black
        else:
            self.BackColor = Color.FromArgb(45, 45, 48)  # Dark theme
            self.ForeColor = Color.White

        self.create_form()
        self.create_ok_button()

    def create_form(self):
        """Cria a Label com as opções e o campo de entrada de texto."""
        lbl_options = Label()
        lbl_options.Text = "\nEscolha uma opção:\n\n1 - AUTOMACAO\n2 - CFTV\n3 - ELETRICO\n4 - INCENDIO\n5 - LUMINOTECNICO\n6 - CABEAMENTO ESTRUTURADO\n7 - SPDA\n8 - SDAI"
        lbl_options.Location = Point(20, 20)
        lbl_options.Size = Size(300, 120)
        lbl_options.AutoSize = True
        self.Controls.Add(lbl_options)

        self.txt_input = TextBox()
        self.txt_input.Location = Point(20, 170)
        self.txt_input.Size = Size(240, 30)
        self.Controls.Add(self.txt_input)

    def create_ok_button(self):
        """Cria o botão OK para capturar o texto e fechar o formulário."""
        btn_ok = Button()
        btn_ok.Text = "OK"
        btn_ok.Location = Point((self.ClientSize.Width - 100) // 2, 200)
        btn_ok.Size = Size(100, 30)
        btn_ok.Click += self.on_ok
        self.Controls.Add(btn_ok)

    def on_ok(self, sender, event):
        """Captura o texto digitado e fecha o formulário."""
        options = {
            1: "AUTOMACAO",
            2: "CFTV",
            3: "ELETRICO",
            4: "INCENDIO",
            5: "LUMINOTECNICO",
            6: "CABEAMENTO ESTRUTURADO",
            7: "SPDA",
            8: "SDAI"
        }

        try:
            input_value = int(self.txt_input.Text)
            if input_value in options:
                self.user_input = options[input_value]
            else:
                self.user_input = None
                self.show_error("Por favor, escolha uma opção válida (1-8).")
        except ValueError:
            self.user_input = None
            self.show_error("Por favor, insira um número válido.")

        self.Close()

    def show_error(self, message):
        """Exibe uma mensagem de erro."""
        error_label = Label()
        error_label.Text = message
        error_label.Location = Point(20, 220)
        error_label.Size = Size(300, 30)
        error_label.ForeColor = Color.Red
        self.Controls.Add(error_label)

# Criação do formulário
theme = "Dark"  # Você pode mudar para "Light" se quiser o tema claro
form = MyForm(theme)
Application.Run(form)

# O texto correspondente à opção escolhida será armazenado na variável 'form.user_input'
OUT = form.user_input
# ----------------------------------------
