# Dynamo graph SOMAR TABELAS DE CABOS_script.dyn "SOMAR TABELAS DE CABOS" (Dynamo 2.13.1.3887)
# packages: bimorphNodes 5.1.2

categories = Categories("OST_GenericModel")
all_elements_of_category = ElementsOfCategory(Category=categories)
string_from_object = FromObject(object=all_elements_of_category)
code_block = CodeBlock { "SOMATORIO"; }
eq = string_from_object == code_block
filterByBoolMask = List.FilterByBoolMask(list=all_elements_of_category, mask=eq)
ELETROCALHA = Views("QUANTITATIVO DE CABOS EM METROS EM ELETROCALHAS  (COBRE/UN/ISOL. EPR/1KV/90°C)")
code_block_2 = CodeBlock { 0; }
boolean = BoolSelector(false)
getDataRows = Revit.Schedule.GetDataRows(scheduleView=ELETROCALHA, rowIndexes=code_block_2, refresh=boolean)
add = _ + _  # unwired: x, y
code_block_3 = CodeBlock { 1; }
boolean_2 = BoolSelector(false)
getDataRows_2 = Revit.Schedule.GetDataRows(scheduleView=ELETROCALHA, rowIndexes=code_block_3, refresh=boolean_2)
toNumber = String.ToNumber(string=getDataRows_2)
CONDUITE = Views("QUANTITATIVO DE CABOS EM METROS (COBRE/UN/ISOL. EPR/1KV/90°C)")
code_block_4 = CodeBlock { 1; }
boolean_3 = BoolSelector(false)
getDataRows_3 = Revit.Schedule.GetDataRows(scheduleView=CONDUITE, rowIndexes=code_block_4, refresh=boolean_3)
toNumber_2 = String.ToNumber(string=getDataRows_3)
laceShortest = List.LaceShortest(combineFunction=add, list0=toNumber, list1=toNumber_2)
code_block_5 = CodeBlock { 10; }
div = laceShortest / code_block_5  # lacing=Longest
list_create = List.Create(item0=div)
flatten = List.Flatten(list=list_create, lacing=Longest)
setParameterByName = Element.SetParameterByName(element=filterByBoolMask.in, parameterName=getDataRows, value=flatten)
total_cabos = Views("01 - QUANTITATIVO DE CABOS EM METROS (COBRE/UN/ISOL. EPR/1KV/90°C)")
code_block_6 = CodeBlock { 0; }
boolean_4 = BoolSelector(true)
getDataRows_4 = Revit.Schedule.GetDataRows(scheduleView=total_cabos, rowIndexes=code_block_6, refresh=boolean_4)
flatten_2 = List.Flatten(list=flatten)
code_block_7 = CodeBlock { [0,15,30,45,60,75]; }
getItemAtIndex = List.GetItemAtIndex(list=flatten_2, index=code_block_7)
sum = Math.Sum(values=getItemAtIndex)
list_create_2 = List.Create(item0=sum)
flatten_3 = List.Flatten(list=list_create_2)
code_block_8 = CodeBlock { [1,16,31,46,61,76]; }
getItemAtIndex_2 = List.GetItemAtIndex(list=flatten_2, index=code_block_8)
sum_2 = Math.Sum(values=getItemAtIndex_2)
list_create_3 = List.Create(item0=sum_2)
flatten_4 = List.Flatten(list=list_create_3)
code_block_9 = CodeBlock { [2,17,32,47,62,77]; }
getItemAtIndex_3 = List.GetItemAtIndex(list=flatten_2, index=code_block_9)
sum_3 = Math.Sum(values=getItemAtIndex_3)
list_create_4 = List.Create(item0=sum_3)
flatten_5 = List.Flatten(list=list_create_4)
code_block_10 = CodeBlock { [3,18,33,48,63]; }
getItemAtIndex_4 = List.GetItemAtIndex(list=flatten_2, index=code_block_10)
sum_4 = Math.Sum(values=getItemAtIndex_4)
list_create_5 = List.Create(item0=sum_4)
flatten_6 = List.Flatten(list=list_create_5)
code_block_11 = CodeBlock { [4,19,34,49,64]; }
getItemAtIndex_5 = List.GetItemAtIndex(list=flatten_2, index=code_block_11)
sum_5 = Math.Sum(values=getItemAtIndex_5)
list_create_6 = List.Create(item0=sum_5)
flatten_7 = List.Flatten(list=list_create_6)
code_block_12 = CodeBlock { [5,20,35,50,65]; }
getItemAtIndex_6 = List.GetItemAtIndex(list=flatten_2, index=code_block_12)
sum_6 = Math.Sum(values=getItemAtIndex_6)
list_create_7 = List.Create(item0=sum_6)
flatten_8 = List.Flatten(list=list_create_7)
code_block_13 = CodeBlock { [6,21,36,51,66]; }
getItemAtIndex_7 = List.GetItemAtIndex(list=flatten_2, index=code_block_13)
sum_7 = Math.Sum(values=getItemAtIndex_7)
list_create_8 = List.Create(item0=sum_7)
flatten_9 = List.Flatten(list=list_create_8)
code_block_14 = CodeBlock { [7,22,37,52,67]; }
getItemAtIndex_8 = List.GetItemAtIndex(list=flatten_2, index=code_block_14)
sum_8 = Math.Sum(values=getItemAtIndex_8)
list_create_9 = List.Create(item0=sum_8)
flatten_10 = List.Flatten(list=list_create_9)
code_block_15 = CodeBlock { [8,23,38,53,68]; }
getItemAtIndex_9 = List.GetItemAtIndex(list=flatten_2, index=code_block_15)
sum_9 = Math.Sum(values=getItemAtIndex_9)
list_create_10 = List.Create(item0=sum_9)
flatten_11 = List.Flatten(list=list_create_10)
code_block_16 = CodeBlock { [9,24,39,54,69]; }
getItemAtIndex_10 = List.GetItemAtIndex(list=flatten_2, index=code_block_16)
sum_10 = Math.Sum(values=getItemAtIndex_10)
list_create_11 = List.Create(item0=sum_10)
flatten_12 = List.Flatten(list=list_create_11)
code_block_17 = CodeBlock { [10,25,40,55,70]; }
getItemAtIndex_11 = List.GetItemAtIndex(list=flatten_2, index=code_block_17)
sum_11 = Math.Sum(values=getItemAtIndex_11)
list_create_12 = List.Create(item0=sum_11)
flatten_13 = List.Flatten(list=list_create_12)
code_block_18 = CodeBlock { [11,26,41,56,71]; }
getItemAtIndex_12 = List.GetItemAtIndex(list=flatten_2, index=code_block_18)
sum_12 = Math.Sum(values=getItemAtIndex_12)
list_create_13 = List.Create(item0=sum_12)
flatten_14 = List.Flatten(list=list_create_13)
code_block_19 = CodeBlock { [12,27,42,57,72]; }
getItemAtIndex_13 = List.GetItemAtIndex(list=flatten_2, index=code_block_19)
sum_13 = Math.Sum(values=getItemAtIndex_13)
list_create_14 = List.Create(item0=sum_13)
flatten_15 = List.Flatten(list=list_create_14)
code_block_20 = CodeBlock { [13,28,43,58,73]; }
getItemAtIndex_14 = List.GetItemAtIndex(list=flatten_2, index=code_block_20)
sum_14 = Math.Sum(values=getItemAtIndex_14)
list_create_15 = List.Create(item0=sum_14)
flatten_16 = List.Flatten(list=list_create_15)
code_block_21 = CodeBlock { [14,29,44,59,74]; }
getItemAtIndex_15 = List.GetItemAtIndex(list=flatten_2, index=code_block_21)
sum_15 = Math.Sum(values=getItemAtIndex_15)
list_create_16 = List.Create(item0=sum_15)
flatten_17 = List.Flatten(list=list_create_16)
list_create_17 = List.Create(item0=flatten_3, item1=flatten_4, item2=flatten_5, item3=flatten_6, item4=flatten_7, item5=flatten_8, item6=flatten_9, item7=flatten_10, item8=flatten_11, item9=flatten_12, item10=flatten_13, item11=flatten_14, item12=flatten_15, item13=flatten_16, item14=flatten_17)
flatten_18 = List.Flatten(list=list_create_17@L3)
setParameterByName_2 = Element.SetParameterByName(element=filterByBoolMask.in, parameterName=getDataRows_4, value=flatten_18)
string = StringInput("R")
string_2 = StringInput("A")
replace = String.Replace(string=getDataRows, searchFor=string, replaceWith=string_2)
flatten_19 = List.Flatten(list=replace)
string_3 = StringInput("S")
string_4 = StringInput("B")
replace_2 = String.Replace(string=flatten_19, searchFor=string_3, replaceWith=string_4)
flatten_20 = List.Flatten(list=replace_2)
string_5 = StringInput("T")
string_6 = StringInput("C")
replace_3 = String.Replace(string=flatten_20, searchFor=string_5, replaceWith=string_6)
flatten_21 = List.Flatten(list=replace_3)
string_7 = StringInput("Ae")
string_8 = StringInput("Re")
replace_4 = String.Replace(string=flatten_21, searchFor=string_7, replaceWith=string_8)
code_block_22 = CodeBlock { 0; }
boolean_5 = BoolSelector(false)
getDataRows_5 = Revit.Schedule.GetDataRows(scheduleView=CONDUITE, rowIndexes=code_block_22, refresh=boolean_5)
